# Grasshopper definition 4A_HELIX.gh (Grasshopper 1.0.8)

pivot = Geometry([Point(-6.83951211, -1.317268842, 14.87076134), Point(-5.024365793, -4.3510185, 13.69427602), Point(-2.080242047, -5.998064053, 12.58266744), Point(1.141589132, -5.960572005, 11.52970009), Point(3.799509293, -4.393582021, 10.54385151), Point(5.895252496, -1.239871689, 11.50495387)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])
loop_length = Number(12)
vertex = Geometry([Point(-10.13608081, 0.9710519212, 24.01165213), Point(-8.536641106, -3.894164372, 21.71533887), Point(-5.040887477, -7.067410166, 19.6712029), Point(-0.7769609458, -8.021168757, 17.83533269), Point(3.110834052, -6.835444091, 16.19611835), Point(7.138374822, -3.83969788, 17.81864886)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])
# expanding helix
number_slider = Slider(1.2, range=1..3)
multiplication = Multiplication(A=pivot, B=number_slider)
multiplication_2 = Multiplication(A=vertex, B=number_slider)
cluster = Cluster_2(
    vertices=multiplication_2,
    loop_count=loop_length,
    pivots=multiplication,
    rod_thickness=Slider(0.154, range=0..1),
    sphere_radius=Slider(0.415, range=0..1),
    button=Button())  # -> left_legs, right_legs
flip = FlipMatrix(Data=multiplication)
path_mapper = PathMapper(cluster.right_legs, source="{A;B;C}(i)", target="{0;i}")
path_mapper_2 = PathMapper(cluster.left_legs, source="{A;B;C}(i)", target="{0;i}")
path_mapper_3 = PathMapper(flip, source="{A}(i)", target="{0;A}(i)")
pivot_2 = Geometry(path_mapper_3)
left_leg = Geometry(path_mapper_2)
right_leg = Geometry(path_mapper)

# ==== cluster Cluster_2
rod_thickness = ClusterInput()
sphere_radius = ClusterInput()
vertices = ClusterInput()
button = ClusterInput()
pivots = ClusterInput()
loop_count = ClusterInput()
rod_thickness_2 = Number(rod_thickness)
sphere_radius_2 = Number(sphere_radius)
vertices_2 = Geometry(vertices)
button_2 = Boolean(button)
pivots_2 = Geometry(pivots)
loop_count_2 = Number(loop_count)
lng = ListLength(List=vertices_2)
subtraction = Subtraction(A=lng, B=loop_count_2)
sph = Sphere(Base=vertices_2, Radius=sphere_radius_2)
sph_2 = Sphere(Base=pivots_2, Radius=sphere_radius_2)
layertable = LayerTable(Update=True, AutoUpdate=True)  # -> Layers, FullLayerPaths, LayerColors, Linetypes, MaterialNames, Visible, PrintWidth, PrintColor
layertable_2 = LayerTable(Update=True, AutoUpdate=True)  # -> Layers, FullLayerPaths, LayerColors, Linetypes, MaterialNames, Visible, PrintWidth, PrintColor
number_slider = Slider(3, range=0..10)
number_slider_2 = Slider(2, range=0..10)
split = SplitList(List=vertices_2, Index=subtraction)  # -> ListA, ListB
split_2 = SplitList(List=vertices_2, Index=loop_count_2)  # -> ListA, ListB
item = ListItem(List=layertable_2.LayerColors, Index=number_slider_2, Wrap=True)
item_2 = ListItem(List=layertable.LayerColors, Index=number_slider, Wrap=True)
geo = Geometry(split.ListA)
geo_2 = Geometry(split_2.ListB)
preview = CustomPreview(Geometry=sph_2, Material=item_2)
item_3 = ListItem(List=layertable_2.Layers, Index=number_slider_2, Wrap=True)
preview_2 = CustomPreview(Geometry=sph, Material=item)
cluster = Cluster(old_vertex=geo, new_vertex=geo_2)  # -> left_legs, right_legs
item_4 = ListItem(List=layertable.Layers, Index=number_slider, Wrap=True)  # -> flatten(Item)
createatts = CreateAttributes(LayerName=item_3, enableFullPath=False)
bake = BakeGeometry(Bake=button_2, Geometry=sph, Attributes=createatts, DeleteOldBakes=False, PreserveTrees=False)
createatts_2 = CreateAttributes(LayerName=item_4, enableFullPath=False)
bake_2 = BakeGeometry(Bake=button_2, Geometry=sph_2, Attributes=createatts_2, DeleteOldBakes=False, PreserveTrees=False)
merge = Merge(Data1=cluster.left_legs, Data2=cluster.right_legs)
pipe = Pipe(Curve=merge, Radius=rod_thickness_2, Caps=0)
layertable_3 = LayerTable(Update=True, AutoUpdate=True)  # -> Layers, FullLayerPaths, LayerColors, Linetypes, MaterialNames, Visible, PrintWidth, PrintColor
number_slider_3 = Slider(1, range=0..10)
right_legs = ClusterOutput(cluster.right_legs)
left_legs = ClusterOutput(cluster.left_legs)
item_5 = ListItem(List=layertable_3.Layers, Index=number_slider_3, Wrap=True)
createatts_3 = CreateAttributes(LayerName=item_5, enableFullPath=False)
item_6 = ListItem(List=layertable_3.LayerColors, Index=number_slider_3, Wrap=True)
bake_3 = BakeGeometry(Bake=button_2, Geometry=pipe, Attributes=createatts_3, DeleteOldBakes=False, PreserveTrees=False)
preview_3 = CustomPreview(Geometry=pipe, Material=item_6)

# ==== cluster Cluster
old_vertex = ClusterInput()
new_vertex = ClusterInput()
cull_index = CullIndex(List=old_vertex, Indices="0", Wrap=True)
cull_index_2 = CullIndex(List=new_vertex, Indices="0", Wrap=True)
cull_index_3 = CullIndex(List=old_vertex, Indices="-1", Wrap=True)
cull_index_4 = CullIndex(List=new_vertex, Indices="-1", Wrap=True)
line = Line(StartPoint=cull_index_3, EndPoint=cull_index_2)
line_2 = Line(StartPoint=cull_index, EndPoint=cull_index_4)
left_legs = ClusterOutput(line)
right_legs = ClusterOutput(line_2)
