# Grasshopper definition FINAL_4B_TORUS.gh (Grasshopper 1.0.8)

scissor_pivots = Geometry(Tree({0;0}: [Point(10.8798695, -2.915252213, 3.641016022), Point(7.964617286, -7.964617282, 3.641015989), Point(2.915252216, -10.8798695, 3.641016021), Point(-2.915252213, -10.8798695, 3.641016022), Point(-7.964617282, -7.964617286, 3.641015989), Point(-10.8798695, -2.915252216, 3.641016021), Point(-10.8798695, 2.915252213, 3.641016022), Point(-7.964617286, 7.964617282, 3.641015989), Point(-2.915252216, 10.8798695, 3.641016021), Point(2.915252213, 10.8798695, 3.641016022), Point(7.964617282, 7.964617286, 3.641015989), Point(10.8798695, 2.915252216, 3.641016021)], {0;1}: [Point(13.04698548, -3.495929345, 2.969771673e-08), Point(9.55105634, -9.551056342, 2.606836302e-08), Point(3.49592935, -13.04698548, 2.722166315e-08), Point(-3.49592934, -13.04698548, 2.726314863e-08), Point(-9.551056342, -9.55105634, 2.60683648e-08), Point(-13.04698548, -3.49592935, 2.722166714e-08), Point(-13.04698548, 3.49592934, 2.726314863e-08), Point(-9.55105634, 9.551056342, 2.606836347e-08), Point(-3.49592935, 13.04698548, 2.722166714e-08), Point(3.49592934, 13.04698548, 2.726314952e-08), Point(9.551056342, 9.55105634, 2.606835814e-08), Point(13.04698548, 3.495929348, 2.726313664e-08)], {0;2}: [Point(10.8798695, -2.915252261, -3.641015981), Point(7.964617328, -7.964617334, -3.641015892), Point(2.91525226, -10.87986951, -3.641015981), Point(-2.915252255, -10.87986951, -3.641015984), Point(-7.96461733, -7.964617332, -3.641015895), Point(-10.87986951, -2.91525226, -3.641015981), Point(-10.87986951, 2.915252255, -3.641015984), Point(-7.964617332, 7.96461733, -3.641015895), Point(-2.91525226, 10.87986951, -3.641015981), Point(2.915252255, 10.87986951, -3.641015984), Point(7.964617331, 7.964617331, -3.641015895), Point(10.8798695, 2.915252259, -3.64101598)], {0;3}: [Point(7.009452215, -1.87817697, -3.163961362), Point(5.131275099, -5.131275107, -3.163961294), Point(1.878176965, -7.009452228, -3.163961362), Point(-1.878176972, -7.009452227, -3.163961364), Point(-5.131275102, -5.131275108, -3.163961295), Point(-7.009452225, -1.878176971, -3.163961361), Point(-7.009452227, 1.878176972, -3.163961364), Point(-5.131275108, 5.131275102, -3.163961295), Point(-1.878176971, 7.009452225, -3.163961361), Point(1.878176973, 7.009452226, -3.163961364), Point(5.131275103, 5.131275109, -3.163961295), Point(7.00945222, 1.878176975, -3.163961362)], {0;4}: [Point(5.613268508, -1.504070796, -2.454521919e-08), Point(4.109197709, -4.109197715, 1.207771967e-07), Point(1.50407079, -5.613268519, -2.452020409e-08), Point(-1.504070804, -5.61326852, -2.92381892e-08), Point(-4.109197718, -4.109197718, 1.172874153e-07), Point(-5.613268518, -1.504070801, -1.997320664e-08), Point(-5.613268521, 1.504070798, -2.491030537e-08), Point(-4.109197718, 4.109197718, 1.17287418e-07), Point(-1.5040708, 5.613268518, -1.885249112e-08), Point(1.504070799, 5.613268521, -2.517082232e-08), Point(4.109197717, 4.109197723, 1.133478564e-07), Point(5.613268516, 1.504070796, -2.041555902e-08)], {0;5}: [Point(7.009452122, -1.878177088, 3.163961377), Point(5.131274948, -5.131274954, 3.16396125), Point(1.878177085, -7.009452137, 3.163961385), Point(-1.878177097, -7.009452136, 3.163961376), Point(-5.131274963, -5.13127495, 3.163961239), Point(-7.009452141, -1.878177089, 3.163961385), Point(-7.009452149, 1.878177087, 3.16396139), Point(-5.13127496, 5.131274963, 3.16396125), Point(-1.878177089, 7.009452141, 3.163961386), Point(1.878177079, 7.009452147, 3.163961383), Point(5.131274973, 5.131274959, 3.163961254), Point(7.009452133, 1.878177088, 3.163961385)], {0;6}: [Point(10.87986944, -2.915251784, 3.641015705), Point(7.964616798, -7.964616813, 3.641015507), Point(2.91525178, -10.87986947, 3.641015717), Point(-2.915251789, -10.87986948, 3.641015705), Point(-7.964616824, -7.96461681, 3.641015492), Point(-10.87986947, -2.915251758, 3.641015716), Point(-10.8798695, 2.915251805, 3.641015726), Point(-7.964616862, 7.964616837, 3.64101551), Point(-2.915251797, 10.87986946, 3.641015718), Point(2.915251827, 10.8798695, 3.641015717), Point(7.96461685, 7.964616871, 3.641015517), Point(10.87986945, 2.915251795, 3.641015718)]))
vertices = Geometry(Tree({0;0;0}: [Point(10, 0, 4.6), Point(8.660254066, -4.999999952, 4.6), Point(4.999999957, -8.660254063, 4.6), Point(0, -10, 4.6), Point(-4.999999952, -8.660254066, 4.6), Point(-8.660254063, -4.999999957, 4.6), Point(-10, 0, 4.6), Point(-8.660254066, 4.999999952, 4.6), Point(-4.999999957, 8.660254063, 4.6), Point(0, 10, 4.6), Point(4.999999952, 8.660254066, 4.6), Point(8.660254063, 4.999999957, 4.6), Point(10, 0, 4.6)], {0;1;0}: [Point(13.98371687, 0, 2.29999998), Point(12.11025413, -6.991858524, 2.299999929), Point(6.99185853, -12.11025414, 2.299999927), Point(3.898579681e-09, -13.98371687, 2.299999978), Point(-6.991858524, -12.11025413, 2.299999929), Point(-12.11025414, -6.99185853, 2.299999927), Point(-13.98371687, -3.898583678e-09, 2.299999978), Point(-12.11025413, 6.991858524, 2.299999929), Point(-6.99185853, 12.11025414, 2.299999927), Point(-3.898592116e-09, 13.98371687, 2.299999978), Point(6.991858524, 12.11025413, 2.299999929), Point(12.11025414, 6.99185853, 2.299999927), Point(13.98371687, 0, 2.29999998)], {0;2;0}: [Point(13.98371687, 0, -2.299999978), Point(12.11025412, -6.991858579, -2.299999848), Point(6.991858579, -12.11025413, -2.299999847), Point(5.577144524e-09, -13.98371688, -2.299999981), Point(-6.991858575, -12.11025412, -2.299999852), Point(-12.11025413, -6.991858579, -2.299999847), Point(-13.98371688, -5.577139195e-09, -2.299999981), Point(-12.11025412, 6.991858575, -2.299999852), Point(-6.991858579, 12.11025413, -2.299999847), Point(-5.577154738e-09, 13.98371688, -2.299999981), Point(6.991858575, 12.11025412, -2.299999852), Point(12.11025413, 6.991858578, -2.299999848), Point(13.98371687, 0, -2.299999978)], {0;3;0}: [Point(10, 0, -4.6), Point(8.660254114, -4.99999999, -4.59999991), Point(4.999999986, -8.660254125, -4.599999908), Point(5.746514375e-12, -10.00000001, -4.6), Point(-4.999999985, -8.660254122, -4.599999913), Point(-8.660254121, -4.999999991, -4.59999991), Point(-10.00000001, -5.733191699e-12, -4.6), Point(-8.660254122, 4.999999985, -4.599999913), Point(-4.999999991, 8.660254121, -4.59999991), Point(-5.727418539e-12, 10.00000001, -4.6), Point(4.999999986, 8.660254121, -4.599999914), Point(8.660254122, 4.999999991, -4.599999911), Point(10, 0, -4.6)], {0;4;0}: [Point(6.016283131, 0, -2.29999998), Point(5.210253922, -3.008141459, -2.299999823), Point(3.008141452, -5.210253932, -2.299999822), Point(-5.511530787e-09, -6.016283145, -2.299999981), Point(-3.008141461, -5.210253934, -2.299999827), Point(-5.210253928, -3.008141461, -2.299999821), Point(-6.016283142, 3.733415799e-10, -2.299999979), Point(-5.210253934, 3.008141461, -2.299999827), Point(-3.008141461, 5.210253928, -2.299999821), Point(1.703899244e-09, 6.016283142, -2.299999978), Point(3.008141462, 5.210253935, -2.299999827), Point(5.210253929, 3.008141467, -2.299999823), Point(6.016283131, 0, -2.29999998)], {0;5;0}: [Point(6.01628313, 0, 2.299999978), Point(5.21025389, -3.008141574, 2.299999904), Point(3.008141571, -5.210253897, 2.299999909), Point(-8.457655909e-09, -6.016283143, 2.299999982), Point(-3.008141586, -5.210253899, 2.299999896), Point(-5.2102539, -3.008141579, 2.299999902), Point(-6.016283145, -3.778272806e-09, 2.299999991), Point(-5.210253904, 3.008141581, 2.299999905), Point(-3.008141577, 5.210253902, 2.299999905), Point(-2.666882271e-09, 6.016283145, 2.29999999), Point(3.008141577, 5.210253906, 2.299999897), Point(5.210253905, 3.008141577, 2.299999916), Point(6.01628313, 0, 2.299999978)], {0;6;0}: [Point(10, 0, 4.6), Point(8.660253519, -4.99999964, 4.59999965), Point(4.999999637, -8.66025353, 4.59999966), Point(-2.193591087e-09, -10.00000003, 4.600000012), Point(-4.999999658, -8.660253538, 4.599999644), Point(-8.660253537, -4.999999626, 4.599999645), Point(-10.00000003, 3.868709797e-10, 4.600000021), Point(-8.660253572, 4.999999658, 4.599999669), Point(-4.999999646, 8.660253548, 4.599999657), Point(-1.031625896e-08, 10.00000001, 4.600000012), Point(4.999999677, 8.660253588, 4.59999967), Point(8.660253548, 4.999999641, 4.59999967), Point(10, 0, 4.6)], {0;7;0}: [Point(13.98371687, 0, 2.29999998), Point(12.11025414, -6.991857971, 2.299999011), Point(6.991857953, -12.11025417, 2.299999026), Point(-3.932752346e-09, -13.98371692, 2.299999997), Point(-6.991857987, -12.1102542, 2.29999899), Point(-12.11025418, -6.991857952, 2.299998995), Point(-13.98371691, 4.607741078e-08, 2.300000013), Point(-12.11025424, 6.991858015, 2.299999035), Point(-6.991858034, 12.11025419, 2.29999901), Point(3.67573012e-08, 13.98371694, 2.299999974), Point(6.991858047, 12.11025427, 2.299999036), Point(12.11025419, 6.991858036, 2.299999029), Point(13.98371687, 0, 2.29999998)]))
cluster = Cluster_2(
    vertices=vertices,
    pivots=scissor_pivots,
    rod_thickness=Slider(0.137, range=0..1),
    sphere_radius=Slider(0.472, range=0..1),
    button=Button())  # -> left_legs, right_legs
path_mapper = PathMapper(cluster.left_legs, source="{A;B}(i)", target="{A;i}")
path_mapper_2 = PathMapper(scissor_pivots, source="{A;B}(i)", target="{B;i}")
path_mapper_3 = PathMapper(cluster.right_legs, source="{A;B}(i)", target="{A;i}")
left_strip = Geometry(path_mapper)
pivot = Geometry(path_mapper_2)
right_strip = Geometry(path_mapper_3)

# ==== cluster Cluster_2
rod_thickness = ClusterInput()
sphere_radius = ClusterInput()
vertices = ClusterInput()
button = ClusterInput()
pivots = ClusterInput()
rod_thickness_2 = Number(rod_thickness)
sphere_radius_2 = Number(sphere_radius)
vertices_2 = Geometry(vertices)
button_2 = Boolean(button)
pivots_2 = Geometry(pivots)
sph = Sphere(Base=vertices_2, Radius=sphere_radius_2)
geo = Geometry(vertices_2)
sph_2 = Sphere(Base=pivots_2, Radius=sphere_radius_2)
tstat = TreeStatistics(Tree=geo)  # -> Paths, Length, Count
subtraction = Subtraction(A=tstat.Count, B=1)
layertable = LayerTable(Update=True, AutoUpdate=True)  # -> Layers, FullLayerPaths, LayerColors, Linetypes, MaterialNames, Visible, PrintWidth, PrintColor
layertable_2 = LayerTable(Update=True, AutoUpdate=True)  # -> Layers, FullLayerPaths, LayerColors, Linetypes, MaterialNames, Visible, PrintWidth, PrintColor
number_slider = Slider(3, range=0..10)
number_slider_2 = Slider(2, range=0..10)
series = Series(Start=0, Step=1, Count=subtraction)  # -> flatten(Series)
addition = Addition(A=series, B="1")
item = ListItem(List=layertable_2.MaterialNames, Index=number_slider, Wrap=True)
item_2 = ListItem(List=layertable.MaterialNames, Index=number_slider_2, Wrap=True)
preview = CustomPreview(Geometry=sph_2, Material=item)
item_3 = ListItem(List=tstat.Paths, Index=series, Wrap=True)
item_4 = ListItem(List=tstat.Paths, Index=addition, Wrap=True)
item_5 = ListItem(List=layertable.Layers, Index=number_slider_2, Wrap=True)  # -> flatten(Item)
preview_2 = CustomPreview(Geometry=sph, Material=item_2)
item_6 = ListItem(List=layertable_2.Layers, Index=number_slider, Wrap=True)  # -> flatten(Item)
createatts = CreateAttributes(LayerName=item_5, enableFullPath=False)
branch = TreeBranch(Tree=geo, Path=item_4, MaintainPaths=False)
branch_2 = TreeBranch(Tree=geo, Path=item_3, MaintainPaths=False)
createatts_2 = CreateAttributes(LayerName=item_6, enableFullPath=False)
cluster = Cluster(old_vertex=branch_2, new_vertex=branch)  # -> left_legs, right_legs
bake = BakeGeometry(Bake=button_2, Geometry=sph, Attributes=createatts, DeleteOldBakes=False, PreserveTrees=False)
bake_2 = BakeGeometry(Bake=button_2, Geometry=sph_2, Attributes=createatts_2, DeleteOldBakes=False, PreserveTrees=False)
merge = Merge(Data1=cluster.left_legs, Data2=cluster.right_legs)
left_legs = ClusterOutput(cluster.left_legs)
right_legs = ClusterOutput(cluster.right_legs)
pipe = Pipe(Curve=merge, Radius=rod_thickness_2, Caps=0)
layertable_3 = LayerTable(Update=True, AutoUpdate=True)  # -> Layers, FullLayerPaths, LayerColors, Linetypes, MaterialNames, Visible, PrintWidth, PrintColor
number_slider_3 = Slider(1, range=0..10)
item_7 = ListItem(List=layertable_3.Layers, Index=number_slider_3, Wrap=True)
createatts_3 = CreateAttributes(LayerName=item_7, enableFullPath=False)
item_8 = ListItem(List=layertable_3.MaterialNames, Index=number_slider_3, Wrap=True)
bake_3 = BakeGeometry(Bake=button_2, Geometry=pipe, Attributes=createatts_3, DeleteOldBakes=False, PreserveTrees=False)
preview_3 = CustomPreview(Geometry=pipe, Material=item_8)

# ==== cluster Cluster
old_vertex = ClusterInput()
new_vertex = ClusterInput()
cull_index = CullIndex(List=old_vertex, Indices="0", Wrap=True)
cull_index_2 = CullIndex(List=new_vertex, Indices="0", Wrap=True)
cull_index_3 = CullIndex(List=old_vertex, Indices="-1", Wrap=True)
cull_index_4 = CullIndex(List=new_vertex, Indices="-1", Wrap=True)
line = Line(StartPoint=cull_index_3, EndPoint=cull_index_2)
line_2 = Line(StartPoint=cull_index, EndPoint=cull_index_4)
left_legs = ClusterOutput(line)
right_legs = ClusterOutput(line_2)
