# Grasshopper definition FINAL_4C_CIRCLE.gh (Grasshopper 1.0.8)

scissor_pivots = Geometry(Tree({0;0}: [Point(48.9626975, -20.31638252, 0), Point(49.93244392, -16.05343693, 0), Point(49.53740494, -11.69946654, 0), Point(47.8162497, -7.680668466, 0), Point(44.93745693, -4.390430619, 0)], {0;1}: [Point(46.40531568, -23.5746611, 0), Point(48.97938133, -15.98987209, 0), Point(48.61134595, -11.93352548, 0), Point(47.00784344, -8.18943969, 0), Point(41.13904848, -2.738560502, 0)], {0;2}: [Point(44.34442959, -24.27388865, 0), Point(45.55826075, -19.52822184, 0), Point(46.65047573, -12.42913002, 0), Point(42.31634982, -6.701530989, 0), Point(38.99342353, -3.102517068, 0)], {0;3}: [Point(39.64136208, -26.3390257, 0), Point(42.16057055, -20.74968455, 0), Point(39.26716426, -14.29524172, 0), Point(38.74632287, -7.241139619, 0), Point(33.87391808, -3.520008429, 0)], {0;4}: [Point(35.01665347, -27.15177081, 0), Point(33.65987133, -21.10788347, 0), Point(34.35295897, -15.53729361, 0), Point(31.09628417, -10.96499535, 0), Point(29.41842523, -5.002259277, 0)], {0;5}: [Point(26.7384478, -25.25566415, 0), Point(27.35021164, -21.97014132, 0), Point(25.23160984, -17.84268955, 0), Point(25.13466178, -13.20427034, 0), Point(23.03527563, -10.60398321, 0)]))
vertices = Geometry(Tree({0}: [Point(48.35364034, -22.49835498, 0), Point(50.0274627, -18.31682519, 0), Point(50.3271986, -13.82271423, 0), Point(49.22350772, -9.455937328, 0), Point(46.82442707, -5.643944985, 0), Point(43.3647954, -2.759881536, 0)], {1}: [Point(46.05680224, -25.77345814, 0), Point(49.55108569, -18.20845753, 0), Point(49.84064972, -13.86685922, 0), Point(48.77441378, -9.648273568, 0), Point(46.45674851, -5.965645277, 0), Point(39.7876478, -0.9694121399, 0)], {2}: [Point(44.67808354, -26.52105554, 0), Point(46.72782585, -21.53992056, 0), Point(48.46448017, -13.99172007, 0), Point(47.50418291, -10.19228321, 0), Point(42.38961857, -4.375709336, 0), Point(38.21928563, -0.9666812744, 0)], {3}: [Point(40.72735769, -28.42299273, 0), Point(44.0628054, -22.37714341, 0), Point(44.58196471, -17.84895361, 0), Point(42.25518862, -8.643013661, 0), Point(39.64684292, -4.905292183, 0), Point(33.83931558, -1.170304605, 0)], {4}: [Point(36.82002666, -28.86711393, 0), Point(38.81636657, -24.75590382, 0), Point(37.8187739, -17.03505627, 0), Point(36.69091159, -12.57264464, 0), Point(33.90020448, -5.305001828, 0), Point(30.19019851, -2.63605497, 0)], {5}: [Point(31.99920433, -29.05438992, 0), Point(31.19762744, -23.51916716, 0), Point(31.284937, -19.42770957, 0), Point(29.80487861, -13.5718266, 0), Point(27.78403124, -10.01319988, 0), Point(25.85932995, -4.761843692, 0)], {6}: [Point(25.94874288, -25.56319162, 0), Point(24.62607643, -23.7303475, 0), Point(22.78155649, -20.13073398, 0), Point(21.98863959, -16.9935412, 0), Point(21.90132247, -12.94979948, 0), Point(22.19428783, -10.70860885, 0)]))
render_and_bake_amigami = Render_and_bake_amigami(
    vertices=vertices,
    pivots=scissor_pivots,
    rod_thickness=Slider(0.137, range=0..1),
    sphere_radius=Slider(0.366, range=0..1),
    button=Button())  # -> simplify(left_legs), simplify(right_legs)
pivot = Geometry(simplify(graft(scissor_pivots)))
left_strip = Geometry(render_and_bake_amigami.left_legs)
right_strip = Geometry(render_and_bake_amigami.right_legs)

# ==== cluster Render_and_bake_amigami
rod_thickness = ClusterInput()
sphere_radius = ClusterInput()
vertices = ClusterInput()
button = ClusterInput()
pivots = ClusterInput()
rod_thickness_2 = Number(rod_thickness)
sphere_radius_2 = Number(sphere_radius)
vertices_2 = Geometry(vertices)
button_2 = Boolean(button)
pivots_2 = Geometry(pivots)
sph = Sphere(Base=vertices_2, Radius=sphere_radius_2)
geo = Geometry(vertices_2)
sph_2 = Sphere(Base=pivots_2, Radius=sphere_radius_2)
tstat = TreeStatistics(Tree=geo)  # -> Paths, Length, Count
subtraction = Subtraction(A=tstat.Count, B=1)
layertable = LayerTable(Update=True, AutoUpdate=True)  # -> Layers, FullLayerPaths, LayerColors, Linetypes, MaterialNames, Visible, PrintWidth, PrintColor
layertable_2 = LayerTable(Update=True, AutoUpdate=True)  # -> Layers, FullLayerPaths, LayerColors, Linetypes, MaterialNames, Visible, PrintWidth, PrintColor
number_slider = Slider(3, range=0..10)
number_slider_2 = Slider(2, range=0..10)
series = Series(Start=0, Step=1, Count=subtraction)  # -> flatten(Series)
addition = Addition(A=series, B="1")
item = ListItem(List=layertable_2.MaterialNames, Index=number_slider, Wrap=True)
item_2 = ListItem(List=layertable.MaterialNames, Index=number_slider_2, Wrap=True)
preview = CustomPreview(Geometry=sph_2, Material=item)
item_3 = ListItem(List=tstat.Paths, Index=series, Wrap=True)
item_4 = ListItem(List=tstat.Paths, Index=addition, Wrap=True)
item_5 = ListItem(List=layertable.Layers, Index=number_slider_2, Wrap=True)  # -> flatten(Item)
preview_2 = CustomPreview(Geometry=sph, Material=item_2)
item_6 = ListItem(List=layertable_2.Layers, Index=number_slider, Wrap=True)  # -> flatten(Item)
createatts = CreateAttributes(LayerName=item_5, enableFullPath=False)
branch = TreeBranch(Tree=geo, Path=item_4, MaintainPaths=False)
branch_2 = TreeBranch(Tree=geo, Path=item_3, MaintainPaths=False)
createatts_2 = CreateAttributes(LayerName=item_6, enableFullPath=False)
cluster = Cluster(old_vertex=branch_2, new_vertex=branch)  # -> left_legs, right_legs
bake = BakeGeometry(Bake=button_2, Geometry=sph, Attributes=createatts, DeleteOldBakes=False, PreserveTrees=False)
bake_2 = BakeGeometry(Bake=button_2, Geometry=sph_2, Attributes=createatts_2, DeleteOldBakes=False, PreserveTrees=False)
merge = Merge(Data1=cluster.left_legs, Data2=cluster.right_legs)
left_legs = ClusterOutput(cluster.left_legs)
right_legs = ClusterOutput(cluster.right_legs)
pipe = Pipe(Curve=merge, Radius=rod_thickness_2, Caps=0)
layertable_3 = LayerTable(Update=True, AutoUpdate=True)  # -> Layers, FullLayerPaths, LayerColors, Linetypes, MaterialNames, Visible, PrintWidth, PrintColor
number_slider_3 = Slider(1, range=0..10)
item_7 = ListItem(List=layertable_3.Layers, Index=number_slider_3, Wrap=True)
createatts_3 = CreateAttributes(LayerName=item_7, enableFullPath=False)
item_8 = ListItem(List=layertable_3.MaterialNames, Index=number_slider_3, Wrap=True)
bake_3 = BakeGeometry(Bake=button_2, Geometry=pipe, Attributes=createatts_3, DeleteOldBakes=False, PreserveTrees=False)
preview_3 = CustomPreview(Geometry=pipe, Material=item_8)

# ==== cluster Cluster
old_vertex = ClusterInput()
new_vertex = ClusterInput()
cull_index = CullIndex(List=old_vertex, Indices="0", Wrap=True)
cull_index_2 = CullIndex(List=new_vertex, Indices="0", Wrap=True)
cull_index_3 = CullIndex(List=old_vertex, Indices="-1", Wrap=True)
cull_index_4 = CullIndex(List=new_vertex, Indices="-1", Wrap=True)
line = Line(StartPoint=cull_index_3, EndPoint=cull_index_2)
line_2 = Line(StartPoint=cull_index, EndPoint=cull_index_4)
left_legs = ClusterOutput(line)
right_legs = ClusterOutput(line_2)
