# Grasshopper definition ellipsoid.gh (Grasshopper 1.0.8)

scissor_pivots = Geometry(Tree({0;0}: [Point(1.190931724, -139.2026197, 3.351593005), Point(0.5613868712, -141.0333895, 5.482659223), Point(-0.2118587926, -143.1888072, 6.291959427), Point(-1.063977418, -145.5467949, 6.291394793), Point(-1.988037933, -148.0748128, 5.336885456), Point(-2.507856685, -149.4992159, 3.686085591)], {0;1}: [Point(4.48216033, -139.6043937, 4.060917443), Point(4.384089096, -141.4479174, 6.244588385), Point(2.629577598, -144.0938384, 7.115120084), Point(2.195286013, -147.1308263, 7.286734974), Point(1.005791505, -149.6637728, 6.220919899), Point(-0.0269410109, -151.3218883, 3.973126666)], {0;2}: [Point(10.94774424, -140.962829, 4.682804411), Point(10.21174454, -142.8761132, 7.044871922), Point(9.638120204, -146.1574394, 8.202596356), Point(7.56565891, -149.5210473, 8.181116343), Point(6.807928842, -152.4678891, 7.124381004), Point(5.83194165, -154.4168676, 4.630562959)], {0;3}: [Point(16.92034745, -143.0080616, 4.218948982), Point(16.07178014, -145.2360859, 6.965821338), Point(15.26342171, -148.2669476, 8.075658195), Point(14.21842291, -151.5450036, 8.038753267), Point(12.04237104, -154.5377832, 6.851147242), Point(11.92399443, -156.7251983, 4.422306827)], {0;4}: [Point(22.68414448, -146.3368985, 3.605392261), Point(22.03039082, -147.9470144, 5.61764929), Point(21.03031532, -150.6863399, 6.715139207), Point(19.98674013, -153.45412, 6.716860653), Point(19.14737649, -156.0764969, 5.592073509), Point(17.67647639, -157.7678405, 3.627806983)]))
vertices = Geometry(Tree({0}: [Point(0.6627449902, -138.7851599, 2.398511851), Point(0.3066907862, -139.771652, 4.64505639), Point(-0.4366296154, -141.8311127, 5.907945657), Point(-1.287970318, -144.1898571, 6.299006539), Point(-2.139311032, -146.5486014, 5.907945647), Point(-2.882631415, -148.6080621, 4.645056411), Point(-3.238685627, -149.5945542, 2.398511851)], {1}: [Point(1.835492816, -138.7878278, 2.408732143), Point(2.026052795, -139.8626694, 4.858518685), Point(0.8054509912, -142.2424575, 6.285297389), Point(0.01248709015, -144.5439348, 6.6752472), Point(-0.7668336189, -147.3468772, 6.281297226), Point(-1.855293373, -149.4140876, 4.835771021), Point(-2.0953605, -150.4800653, 2.630593388)], {2}: [Point(8.054477236, -139.2287413, 2.900836151), Point(7.915866344, -140.6637815, 6.20441245), Point(7.160697032, -143.3145605, 7.876697325), Point(5.392119808, -146.8976557, 8.371842184), Point(4.597014272, -149.9771766, 7.959553459), Point(3.315016348, -152.6820266, 6.142265466), Point(2.418673966, -153.8737738, 2.819248454)], {3}: [Point(14.63081142, -141.3261062, 2.834384116), Point(13.38028854, -142.4207813, 6.181012745), Point(13.00742515, -145.5700597, 8.068295662), Point(11.97846902, -148.8430236, 8.510463588), Point(9.852537051, -152.2812355, 7.980445116), Point(8.983018963, -154.9182436, 6.302741227), Point(8.804980629, -156.466094, 2.844911841)], {4}: [Point(20.07834477, -143.5319595, 2.468641358), Point(19.45176851, -144.8677123, 5.74979043), Point(18.43724026, -147.710361, 7.655562823), Point(17.53738795, -150.985317, 8.083079372), Point(16.26420191, -154.0127571, 7.607934099), Point(14.36163001, -156.9276987, 5.655104878), Point(14.40234466, -158.247913, 2.83767102)], {5}: [Point(24.79481523, -147.2962449, 2.205147201), Point(24.32004433, -148.0978163, 4.319035225), Point(24.10400053, -150.4232478, 5.51138745), Point(23.04241824, -152.9955579, 5.985415206), Point(22.0723192, -155.5562612, 5.553550127), Point(20.85847221, -157.3012776, 4.395708076), Point(20.42152701, -158.4635686, 1.948985492)]))
render_and_bake_amigami = Render_and_bake_amigami(
    vertices=vertices,
    pivots=scissor_pivots,
    rod_thickness=Slider(0.137, range=0..1),
    sphere_radius=Slider(0.366, range=0..1),
    button=Button())  # -> left_legs, right_legs
pivot = Geometry(simplify(graft(scissor_pivots)))
left_strip = Geometry(render_and_bake_amigami.left_legs)
right_strip = Geometry(render_and_bake_amigami.right_legs)

# ==== cluster Render_and_bake_amigami
rod_thickness = ClusterInput()
sphere_radius = ClusterInput()
vertices = ClusterInput()
button = ClusterInput()
pivots = ClusterInput()
rod_thickness_2 = Number(rod_thickness)
sphere_radius_2 = Number(sphere_radius)
vertices_2 = Geometry(vertices)
button_2 = Boolean(button)
pivots_2 = Geometry(pivots)
sph = Sphere(Base=vertices_2, Radius=sphere_radius_2)
geo = Geometry(vertices_2)
sph_2 = Sphere(Base=pivots_2, Radius=sphere_radius_2)
tstat = TreeStatistics(Tree=geo)  # -> Paths, Length, Count
subtraction = Subtraction(A=tstat.Count, B=1)
layertable = LayerTable(Update=True, AutoUpdate=True)  # -> Layers, FullLayerPaths, LayerColors, Linetypes, MaterialNames, Visible, PrintWidth, PrintColor
layertable_2 = LayerTable(Update=True, AutoUpdate=True)  # -> Layers, FullLayerPaths, LayerColors, Linetypes, MaterialNames, Visible, PrintWidth, PrintColor
number_slider = Slider(3, range=0..10)
number_slider_2 = Slider(2, range=0..10)
series = Series(Start=0, Step=1, Count=subtraction)  # -> flatten(Series)
addition = Addition(A=series, B="1")
item = ListItem(List=layertable_2.MaterialNames, Index=number_slider, Wrap=True)
item_2 = ListItem(List=layertable.MaterialNames, Index=number_slider_2, Wrap=True)
preview = CustomPreview(Geometry=sph_2, Material=item)
item_3 = ListItem(List=tstat.Paths, Index=series, Wrap=True)
item_4 = ListItem(List=tstat.Paths, Index=addition, Wrap=True)
item_5 = ListItem(List=layertable.Layers, Index=number_slider_2, Wrap=True)  # -> flatten(Item)
preview_2 = CustomPreview(Geometry=sph, Material=item_2)
item_6 = ListItem(List=layertable_2.Layers, Index=number_slider, Wrap=True)  # -> flatten(Item)
createatts = CreateAttributes(LayerName=item_5, enableFullPath=False)
branch = TreeBranch(Tree=geo, Path=item_4, MaintainPaths=False)
branch_2 = TreeBranch(Tree=geo, Path=item_3, MaintainPaths=False)
createatts_2 = CreateAttributes(LayerName=item_6, enableFullPath=False)
cluster = Cluster(old_vertex=branch_2, new_vertex=branch)  # -> left_legs, right_legs
bake = BakeGeometry(Bake=button_2, Geometry=sph, Attributes=createatts, DeleteOldBakes=False, PreserveTrees=False)
bake_2 = BakeGeometry(Bake=button_2, Geometry=sph_2, Attributes=createatts_2, DeleteOldBakes=False, PreserveTrees=False)
merge = Merge(Data1=cluster.left_legs, Data2=cluster.right_legs)
left_legs = ClusterOutput(cluster.left_legs)
right_legs = ClusterOutput(cluster.right_legs)
pipe = Pipe(Curve=merge, Radius=rod_thickness_2, Caps=0)
layertable_3 = LayerTable(Update=True, AutoUpdate=True)  # -> Layers, FullLayerPaths, LayerColors, Linetypes, MaterialNames, Visible, PrintWidth, PrintColor
number_slider_3 = Slider(1, range=0..10)
item_7 = ListItem(List=layertable_3.Layers, Index=number_slider_3, Wrap=True)
createatts_3 = CreateAttributes(LayerName=item_7, enableFullPath=False)
item_8 = ListItem(List=layertable_3.MaterialNames, Index=number_slider_3, Wrap=True)
bake_3 = BakeGeometry(Bake=button_2, Geometry=pipe, Attributes=createatts_3, DeleteOldBakes=False, PreserveTrees=False)
preview_3 = CustomPreview(Geometry=pipe, Material=item_8)

# ==== cluster Cluster
old_vertex = ClusterInput()
new_vertex = ClusterInput()
cull_index = CullIndex(List=old_vertex, Indices="0", Wrap=True)
cull_index_2 = CullIndex(List=new_vertex, Indices="0", Wrap=True)
cull_index_3 = CullIndex(List=old_vertex, Indices="-1", Wrap=True)
cull_index_4 = CullIndex(List=new_vertex, Indices="-1", Wrap=True)
line = Line(StartPoint=cull_index_3, EndPoint=cull_index_2)
line_2 = Line(StartPoint=cull_index, EndPoint=cull_index_4)
left_legs = ClusterOutput(line)
right_legs = ClusterOutput(line_2)
