# Grasshopper definition EGGBOX.gh (Grasshopper 1.0.8)

vertices = Geometry(Tree({0;0}: [Point(0, 0, 0), Point(8, 0, 0), Point(15.0206605, -3.835404309, 0), Point(19.40810724, -6.23227739, 0), Point(24.40757616, -6.23227739, 0), Point(32.40757616, -6.23227739, 0), Point(39.42823666, -10.0676817, 0), Point(43.81568341, -12.46455478, 0), Point(48.81515233, -12.46455478, 0), Point(56.81515233, -12.46455478, 0), Point(63.83581282, -16.29995909, 0), Point(68.22325957, -18.69683217, 0), Point(73.22272849, -18.69683217, 0), Point(81.22272849, -18.69683217, 0)], {0;1}: [Point(1.500265538, -5.875515979, 0), Point(6.499734462, -5.875515979, 0), Point(10.88718121, -8.27238906, 0), Point(17.9078417, -12.10779337, 0), Point(25.9078417, -12.10779337, 0), Point(30.90731063, -12.10779337, 0), Point(35.29475737, -14.50466645, 0), Point(42.31541787, -18.34007076, 0), Point(50.31541787, -18.34007076, 0), Point(55.31488679, -18.34007076, 0), Point(59.70233354, -20.73694384, 0), Point(66.72299403, -24.57234815, 0), Point(74.72299403, -24.57234815, 0), Point(79.72246296, -24.57234815, 0)]))
scissor_pivots = Geometry([Point(4, -3.615849856, 0), Point(9.776799483, -5.090908934, 0), Point(16.13104222, -7.016884435, 0), Point(21.9078417, -8.491943513, 0), Point(28.40757616, -9.848127246, 0), Point(34.18437565, -11.32318632, 0), Point(40.53861838, -13.24916183, 0), Point(46.31541787, -14.7242209, 0), Point(52.81515233, -16.08040464, 0), Point(58.59195181, -17.55546371, 0), Point(64.94619455, -19.48143922, 0), Point(70.72299403, -20.95649829, 0), Point(77.22272849, -22.31268203, 0)])
render_and_bake_amigami = Render_and_bake_amigami(
    vertices=vertices,
    pivots=scissor_pivots,
    rod_thickness=Slider(0.127, range=0..1),
    sphere_radius=Slider(0.366, range=0..1),
    button=Button())  # -> left_legs, right_legs
flip = FlipMatrix(Data=render_and_bake_amigami.left_legs)
flip_2 = FlipMatrix(Data=render_and_bake_amigami.right_legs)
flip_3 = FlipMatrix(Data=scissor_pivots)
left_legs = Geometry(flip)
scissor_pivots_2 = Geometry(flip_3)
right_legs = Geometry(flip_2)

# ==== cluster Render_and_bake_amigami
rod_thickness = ClusterInput()
sphere_radius = ClusterInput()
vertices = ClusterInput()
button = ClusterInput()
pivots = ClusterInput()
rod_thickness_2 = Number(rod_thickness)
sphere_radius_2 = Number(sphere_radius)
vertices_2 = Geometry(vertices)
button_2 = Boolean(button)
pivots_2 = Geometry(pivots)
sph = Sphere(Base=vertices_2, Radius=sphere_radius_2)
geo = Geometry(vertices_2)
sph_2 = Sphere(Base=pivots_2, Radius=sphere_radius_2)
tstat = TreeStatistics(Tree=geo)  # -> Paths, Length, Count
subtraction = Subtraction(A=tstat.Count, B=1)
layertable = LayerTable(Update=True, AutoUpdate=True)  # -> Layers, FullLayerPaths, LayerColors, Linetypes, MaterialNames, Visible, PrintWidth, PrintColor
layertable_2 = LayerTable(Update=True, AutoUpdate=True)  # -> Layers, FullLayerPaths, LayerColors, Linetypes, MaterialNames, Visible, PrintWidth, PrintColor
number_slider = Slider(3, range=0..10)
number_slider_2 = Slider(2, range=0..10)
series = Series(Start=0, Step=1, Count=subtraction)  # -> flatten(Series)
addition = Addition(A=series, B="1")
item = ListItem(List=layertable_2.MaterialNames, Index=number_slider, Wrap=True)
item_2 = ListItem(List=layertable.MaterialNames, Index=number_slider_2, Wrap=True)
preview = CustomPreview(Geometry=sph_2, Material=item)
item_3 = ListItem(List=tstat.Paths, Index=series, Wrap=True)
item_4 = ListItem(List=tstat.Paths, Index=addition, Wrap=True)
item_5 = ListItem(List=layertable.Layers, Index=number_slider_2, Wrap=True)  # -> flatten(Item)
preview_2 = CustomPreview(Geometry=sph, Material=item_2)
item_6 = ListItem(List=layertable_2.Layers, Index=number_slider, Wrap=True)  # -> flatten(Item)
createatts = CreateAttributes(LayerName=item_5, enableFullPath=False)
branch = TreeBranch(Tree=geo, Path=item_4, MaintainPaths=False)
branch_2 = TreeBranch(Tree=geo, Path=item_3, MaintainPaths=False)
createatts_2 = CreateAttributes(LayerName=item_6, enableFullPath=False)
cluster = Cluster(old_vertex=branch_2, new_vertex=branch)  # -> left_legs, right_legs
bake = BakeGeometry(Bake=button_2, Geometry=sph, Attributes=createatts, DeleteOldBakes=False, PreserveTrees=False)
bake_2 = BakeGeometry(Bake=button_2, Geometry=sph_2, Attributes=createatts_2, DeleteOldBakes=False, PreserveTrees=False)
merge = Merge(Data1=cluster.left_legs, Data2=cluster.right_legs)
left_legs = ClusterOutput(cluster.left_legs)
right_legs = ClusterOutput(cluster.right_legs)
pipe = Pipe(Curve=merge, Radius=rod_thickness_2, Caps=0)
layertable_3 = LayerTable(Update=True, AutoUpdate=True)  # -> Layers, FullLayerPaths, LayerColors, Linetypes, MaterialNames, Visible, PrintWidth, PrintColor
number_slider_3 = Slider(1, range=0..10)
item_7 = ListItem(List=layertable_3.Layers, Index=number_slider_3, Wrap=True)
createatts_3 = CreateAttributes(LayerName=item_7, enableFullPath=False)
item_8 = ListItem(List=layertable_3.MaterialNames, Index=number_slider_3, Wrap=True)
bake_3 = BakeGeometry(Bake=button_2, Geometry=pipe, Attributes=createatts_3, DeleteOldBakes=False, PreserveTrees=False)
preview_3 = CustomPreview(Geometry=pipe, Material=item_8)

# ==== cluster Cluster
old_vertex = ClusterInput()
new_vertex = ClusterInput()
cull_index = CullIndex(List=old_vertex, Indices="0", Wrap=True)
cull_index_2 = CullIndex(List=new_vertex, Indices="0", Wrap=True)
cull_index_3 = CullIndex(List=old_vertex, Indices="-1", Wrap=True)
cull_index_4 = CullIndex(List=new_vertex, Indices="-1", Wrap=True)
line = Line(StartPoint=cull_index_3, EndPoint=cull_index_2)
line_2 = Line(StartPoint=cull_index, EndPoint=cull_index_4)
left_legs = ClusterOutput(line)
right_legs = ClusterOutput(line_2)
