# Grasshopper definition FINAL_4F_NEG_CURVATURE.gh (Grasshopper 1.0.8)

scissor_pivot = Geometry(Tree({0;0}: [Point(10.5, -0.6300791088, 0)], {0;1}: [Point(10.5, -1.918134531, 0)], {0;2}: [Point(10.5, -3.247939367, 0)], {0;3}: [Point(10.5, -4.571685478, 0)], {0;4}: [Point(10.5, -5.807817291, 0)]))
vertex = Geometry(Tree({0;0}: [Point(10, 0, 0), Point(11, 0, 0)], {0;1}: [Point(9.937480463, -1.338942726, 0), Point(11.06251954, -1.338942726, 0)], {0;2}: [Point(9.724049509, -2.717083075, 0), Point(11.27595049, -2.717083075, 0)], {0;3}: [Point(9.304128465, -4.066079103, 0), Point(11.69587153, -4.066079103, 0)], {0;4}: [Point(8.523780364, -5.407217739, 0), Point(12.47621964, -5.407217739, 0)], {0;5}: [Point(7.315451674, -6.453357195, 0), Point(13.68454833, -6.453357195, 0)]))
render_and_bake_amigami = Render_and_bake_amigami(
    vertices=vertex,
    pivots=scissor_pivot,
    rod_thickness=Slider(0.052, range=0..1),
    sphere_radius=Slider(0.224, range=0..1),
    button=Button())  # -> left_legs, right_legs
geo = Geometry(scissor_pivot)
path_mapper = PathMapper(geo, source="{A;B}(i)", target="{B;A}(i)")
scissor_pivot_2 = Geometry(path_mapper)
right_leg = Geometry(render_and_bake_amigami.right_legs)
left_leg = Geometry(render_and_bake_amigami.left_legs)

# ==== cluster Render_and_bake_amigami
rod_thickness = ClusterInput()
sphere_radius = ClusterInput()
vertices = ClusterInput()
button = ClusterInput()
pivots = ClusterInput()
rod_thickness_2 = Number(rod_thickness)
sphere_radius_2 = Number(sphere_radius)
vertices_2 = Geometry(vertices)
button_2 = Boolean(button)
pivots_2 = Geometry(pivots)
sph = Sphere(Base=vertices_2, Radius=sphere_radius_2)
geo = Geometry(vertices_2)
sph_2 = Sphere(Base=pivots_2, Radius=sphere_radius_2)
tstat = TreeStatistics(Tree=geo)  # -> Paths, Length, Count
subtraction = Subtraction(A=tstat.Count, B=1)
layertable = LayerTable(Update=True, AutoUpdate=True)  # -> Layers, FullLayerPaths, LayerColors, Linetypes, MaterialNames, Visible, PrintWidth, PrintColor
layertable_2 = LayerTable(Update=True, AutoUpdate=True)  # -> Layers, FullLayerPaths, LayerColors, Linetypes, MaterialNames, Visible, PrintWidth, PrintColor
number_slider = Slider(3, range=0..10)
number_slider_2 = Slider(2, range=0..10)
series = Series(Start=0, Step=1, Count=subtraction)  # -> flatten(Series)
addition = Addition(A=series, B="1")
item = ListItem(List=layertable_2.MaterialNames, Index=number_slider, Wrap=True)
item_2 = ListItem(List=layertable.MaterialNames, Index=number_slider_2, Wrap=True)
preview = CustomPreview(Geometry=sph_2, Material=item)
item_3 = ListItem(List=tstat.Paths, Index=series, Wrap=True)
item_4 = ListItem(List=tstat.Paths, Index=addition, Wrap=True)
item_5 = ListItem(List=layertable.Layers, Index=number_slider_2, Wrap=True)  # -> flatten(Item)
preview_2 = CustomPreview(Geometry=sph, Material=item_2)
item_6 = ListItem(List=layertable_2.Layers, Index=number_slider, Wrap=True)  # -> flatten(Item)
createatts = CreateAttributes(LayerName=item_5, enableFullPath=False)
branch = TreeBranch(Tree=geo, Path=item_4, MaintainPaths=False)
branch_2 = TreeBranch(Tree=geo, Path=item_3, MaintainPaths=False)
createatts_2 = CreateAttributes(LayerName=item_6, enableFullPath=False)
cluster = Cluster(old_vertex=branch_2, new_vertex=branch)  # -> left_legs, right_legs
bake = BakeGeometry(Bake=button_2, Geometry=sph, Attributes=createatts, DeleteOldBakes=False, PreserveTrees=False)
bake_2 = BakeGeometry(Bake=button_2, Geometry=sph_2, Attributes=createatts_2, DeleteOldBakes=False, PreserveTrees=False)
merge = Merge(Data1=cluster.left_legs, Data2=cluster.right_legs)
left_legs = ClusterOutput(cluster.left_legs)
right_legs = ClusterOutput(cluster.right_legs)
pipe = Pipe(Curve=merge, Radius=rod_thickness_2, Caps=0)
layertable_3 = LayerTable(Update=True, AutoUpdate=True)  # -> Layers, FullLayerPaths, LayerColors, Linetypes, MaterialNames, Visible, PrintWidth, PrintColor
number_slider_3 = Slider(1, range=0..10)
item_7 = ListItem(List=layertable_3.Layers, Index=number_slider_3, Wrap=True)
createatts_3 = CreateAttributes(LayerName=item_7, enableFullPath=False)
item_8 = ListItem(List=layertable_3.MaterialNames, Index=number_slider_3, Wrap=True)
bake_3 = BakeGeometry(Bake=button_2, Geometry=pipe, Attributes=createatts_3, DeleteOldBakes=False, PreserveTrees=False)
preview_3 = CustomPreview(Geometry=pipe, Material=item_8)

# ==== cluster Cluster
old_vertex = ClusterInput()
new_vertex = ClusterInput()
cull_index = CullIndex(List=old_vertex, Indices="0", Wrap=True)
cull_index_2 = CullIndex(List=new_vertex, Indices="0", Wrap=True)
cull_index_3 = CullIndex(List=old_vertex, Indices="-1", Wrap=True)
cull_index_4 = CullIndex(List=new_vertex, Indices="-1", Wrap=True)
line = Line(StartPoint=cull_index_3, EndPoint=cull_index_2)
line_2 = Line(StartPoint=cull_index, EndPoint=cull_index_4)
left_legs = ClusterOutput(line)
right_legs = ClusterOutput(line_2)
